# Grasshopper definition read_JSON.gh (Grasshopper 1.0.8)
# plug-ins: Robot Components

path = FilePath("C:\Users\hamid\Documents\GitHub\eEoodX\sample_output\captures\")
py3 = Python3Script(Folder=path)  # -> out, IDs, Lengths, Widths, Corners, Contours, RGB, Area_mm2; inputs Folder: String
# ---------- py3: Python ----------
import os
import json
import Rhino.Geometry as rg
from Grasshopper import DataTree
from Grasshopper.Kernel.Data import GH_Path


# =========================================================
# OUTPUTS
# =========================================================

IDs = []
Images = []
Lengths = []
Widths = []
Thicknesses = []

Area_mm2 = []
Area_cm2 = []

Defects = []
Hex = []

Data = []


# =========================================================
# DATA TREES
# =========================================================

SideLengths = DataTree[object]()
Corners = DataTree[object]()
Contours = DataTree[object]()
RGB = DataTree[object]()
LAB = DataTree[object]()


# =========================================================
# CHECK FOLDER
# =========================================================

if not Folder:

    print("Please provide a folder path.")

elif not os.path.isdir(Folder):

    print("Folder does not exist:")
    print(Folder)

else:

    # -----------------------------------------------------
    # FIND JSON FILES
    # -----------------------------------------------------

    json_files = [
        f for f in os.listdir(Folder)
        if f.lower().endswith(".json")
    ]

    json_files.sort()

    print("Found {} JSON files.".format(len(json_files)))


    # =====================================================
    # READ FILES
    # =====================================================

    for i, filename in enumerate(json_files):

        filepath = os.path.join(Folder, filename)

        try:

            with open(filepath, "r") as f:
                timber = json.load(f)


            # -------------------------------------------------
            # COMPLETE JSON
            # -------------------------------------------------

            Data.append(timber)


            # -------------------------------------------------
            # BASIC DATA
            # -------------------------------------------------

            IDs.append(
                timber.get("timber_id")
            )

            Images.append(
                timber.get("source_image")
            )

            Lengths.append(
                timber.get("length_mm")
            )

            Widths.append(
                timber.get("width_mm")
            )

            Thicknesses.append(
                timber.get("timber_thickness_mm")
            )

            Area_mm2.append(
                timber.get("surface_area_mm2")
            )

            Area_cm2.append(
                timber.get("surface_area_cm2")
            )

            Hex.append(
                timber.get("color_hex")
            )

            Defects.append(
                timber.get("defects", [])
            )


            # =================================================
            # CREATE BRANCH
            # =================================================

            path = GH_Path(i)


            # =================================================
            # SIDE LENGTHS
            # =================================================

            side_lengths = timber.get(
                "side_lengths_mm",
                []
            )

            for value in side_lengths:

                SideLengths.Add(
                    float(value),
                    path
                )


            # =================================================
            # CORNERS
            # =================================================

            corner_data = timber.get(
                "corners_mm",
                []
            )

            for p in corner_data:

                if len(p) >= 2:

                    point = rg.Point3d(
                        float(p[0]),
                        float(p[1]),
                        0
                    )

                    Corners.Add(
                        point,
                        path
                    )


            # =================================================
            # CONTOUR
            # =================================================

            contour_data = timber.get(
                "contour_mm",
                []
            )

            for p in contour_data:

                if len(p) >= 2:

                    point = rg.Point3d(
                        float(p[0]),
                        float(p[1]),
                        0
                    )

                    Contours.Add(
                        point,
                        path
                    )


            # =================================================
            # RGB
            # =================================================

            rgb_data = timber.get(
                "color_rgb",
                {}
            )

            RGB.Add(
                rgb_data.get("R"),
                path
            )

            RGB.Add(
                rgb_data.get("G"),
                path
            )

            RGB.Add(
                rgb_data.get("B"),
                path
            )


            # =================================================
            # LAB
            # =================================================

            lab_data = timber.get(
                "color_lab",
                {}
            )

            LAB.Add(
                lab_data.get("L"),
                path
            )

            LAB.Add(
                lab_data.get("a"),
                path
            )

            LAB.Add(
                lab_data.get("b"),
                path
            )


        except Exception as e:

            print(
                "ERROR reading {}: {}".format(
                    filename,
                    str(e)
                )
            )


# =========================================================
# SUMMARY
# =========================================================

print(
    "Loaded {} timbers.".format(
        len(Data)
    )
)
# ---------- end py3 ----------
xy = XYPlane(Origin=Point(0, 0, 0))
item = ListItem(List=py3.RGB, Index=0, Wrap=True)  # -> Item, Item1, Item2
bang = ExplodeTree(Data=py3.Contours)  # -> Branch0, Branch1, Branch2, Branch3, Branch4, Branch5, Branch6, Branch7
pv = PlaneVisualizer(Plane=xy)
rgb = ColourRGB(Alpha=255, Red=item.Item, Green=item.Item1, Blue=item.Item2)
pline = PolyLine(Vertices=bang.Branch7, Closed=invert(False))
panel = Panel(rgb)
